# Grasshopper definition 01-tgv3d-bgk.gh (Grasshopper 1.0.8)
# plug-ins: Hawa

# ---- group: 01 / INPUTS
# Hawa guide / purpose: HAWA / 01
# 3D Taylor–Green vortex
# 
# Change grid size, backend and target iterations. Inspect velocity decay.
verification_case = ValueList({"tgv3d-bgk", "tgv2d-bgk", "tgv2d-trt", "tgv2d-smagorinsky", "tgv3d-smagorinsky", "cavity2d-bgk", "poiseuille2d-guo"}, selected="tgv3d-bgk")
grid_sites_per_axis = Slider(16, range=8..64)

# ---- group: 02 / RESULTS / CONTROLS
backend = ValueList({"auto", "mps", "cuda:0", "cpu"}, selected="auto")
# Hawa guide / operation: START / PAUSE / RESET
# Read left to right. Inputs and controls are at the left; results are at the right.
# 
# Save a copy before editing. Wait for preparation. Enable Run only when ready. Solve: Run false pauses; Reset clears state. Evaluate/Search/Record: disabling cancels.
# 
# For recordings, set a new absolute directory before starting.
example = HawaExample(Example=verification_case, Size=grid_sites_per_axis)
target_iterations = Slider(200, range=25..2000)
run_pause = BooleanToggle(False)
reset = BooleanToggle(False)

# ---- group: 03 / RUN / CONTROL
display_field = ValueList({"speed", "pressure", "density"}, selected="speed")
# Hawa guide / limits: CHECK THE RESULT
# Reference units. Use this small case to check installation and backend selection.
# 
# Use the case report and component messages. Compare physical time and fixed colour ranges.
# 
# Examples and MCP instructions: README.md and ../../docs/agents/rhino-mcp.md
solve = HawaSolve(Case=example, Device=backend, TargetSteps=target_iterations, Run=run_pause, Reset=reset)  # -> Solution, State, Steps, Monitor
slice_index_1_middle = Slider(-1, range=-1..63)

# ---- group: 04 / RESULTS / CONTROLS
panel = Panel(solve.State)
panel_2 = Panel(solve.Monitor)
slice = HawaSlice(Solution=solve.Solution, Axis=2, Index=slice_index_1_middle, Field=display_field, Mean=False)  # -> Mesh, Values, Range, Valid

# ---- group: 05 / RESULTS / CONTROLS
color_range_min_max = Panel(slice.Range)
