# Grasshopper definition 04-tgv2d-smagorinsky.gh (Grasshopper 1.0.8)
# plug-ins: Hawa

# ---- group: 01 / CHOOSE A CASE
# HAWA / tgv2d-smagorinsky
# Embedded GPU LBM • editable numerical example
# 1 Choose grid + backend.  2 Double-click Run.  3 Inspect Rhino preview.
# Run false pauses. Reset true → false clears state; Run false → true resumes.
# Change Field and Slice index to explore. Save your copy before experimenting.
# READ THE RESULT
# Blue = low, red = high. Auto range updates each frame.
# Numerical examples use Lettuce reference units.
# Opening stays idle until Run is toggled.
# CPU works everywhere; MPS is Apple GPU; CUDA is NVIDIA.
verification_case = ValueList({"tgv3d-bgk", "tgv2d-bgk", "tgv2d-trt", "tgv2d-smagorinsky", "tgv3d-smagorinsky", "cavity2d-bgk", "poiseuille2d-guo"}, selected="tgv2d-smagorinsky")
grid_sites_per_axis = Slider(16, range=8..64)
example = HawaExample(Example=verification_case, Size=grid_sites_per_axis)

# ---- group: 02 / RUN IN RHINO
backend = ValueList({"auto", "mps", "cuda:0", "cpu"}, selected="auto")
run_pause = BooleanToggle(False)
reset = BooleanToggle(False)
target_iterations = Slider(200, range=25..2000)
solve = HawaSolve(Case=example, Device=backend, TargetSteps=target_iterations, Run=run_pause, Reset=reset)  # -> Solution, State, Steps, Monitor
panel = Panel(solve.Monitor)

# ---- group: 03 / EXPLORE THE FIELD
display_field = ValueList({"speed", "pressure", "density"}, selected="speed")
slice_index_1_middle = Slider(-1, range=-1..63)
slice = HawaSlice(Solution=solve.Solution, Axis=2, Index=slice_index_1_middle, Field=display_field, Mean=False)  # -> Mesh, Values, Range, Valid
panel_2 = Panel(solve.State)
color_range_min_max = Panel(slice.Range)
