# Grasshopper definition 08-wind-around-block.gh (Grasshopper 1.0.8)
# plug-ins: Hawa

# ---- group: 01 / INPUTS
length_units = ValueList({"model", "meters", "millimeters"}, selected="meters")
# Hawa guide / purpose: HAWA / 08
# Wind around a block
# 
# Edit domain, closed mesh, grid spacing and physics. Inspect slice and flow lines.
domain_meters = Box({Plane=PlaneXY(0, 0, 0), X=Domain(0, 16), Y=Domain(0, 8), Z=Domain(0, 8)})
cell_size_model_units = Slider(0.5, range=0.25..1)

# ---- group: 02 / DOMAIN / PHYSICS
closed_block_obstacle = Mesh(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)
# Hawa guide / operation: START / PAUSE / RESET
# Read left to right. Inputs and controls are at the left; results are at the right.
# 
# Save a copy before editing. Wait for preparation. Enable Run only when ready. Solve: Run false pauses; Reset clears state. Evaluate/Search/Record: disabling cancels.
# 
# For recordings, set a new absolute directory before starting.
domain = HawaDomain(Box=domain_meters, CellSize=cell_size_model_units, LengthUnits=length_units)  # -> Domain, Bounds, Grid
viscosity_m²_s = Slider(0.1, range=0.01..0.5)

# ---- group: 03 / GEOMETRY
physics = HawaPhysics(Speed=1, Viscosity=viscosity_m²_s, Density=1.225, Collision="regularized", LatticeMach=0.05)
boundary = HawaBoundaries(X="inlet", X_2="outlet", Y="periodic", Y_2="periodic", Z="wall", Z_2="slip")
# Hawa guide / limits: CHECK THE RESULT
# Geometry uses metres. Demonstration viscosity is not atmospheric air.
# 
# Use the case report and component messages. Compare physical time and fixed colour ranges.
# 
# Examples and MCP instructions: README.md and ../../docs/agents/rhino-mcp.md
geometry = HawaGeometry(Domain=domain.Domain, Obstacles=closed_block_obstacle, CurvedWalls=False)  # -> Geometry, SolidCells

# ---- group: 04 / BUILD CASE
backend = ValueList({"auto", "mps", "cuda:0", "cpu"}, selected="auto")
case = HawaCase(Domain=domain.Domain, Geometry=geometry.Geometry, Physics=physics, Boundaries=boundary)
target_iterations = Slider(300, range=25..2000)
run_pause = BooleanToggle(False)
reset = BooleanToggle(False)

# ---- group: 05 / RUN / CONTROL
streamline_seeds_edit_points = Point([Point(1, 1, 2), Point(1, 2, 2), Point(1, 3, 2), Point(1, 4, 2), Point(1, 5, 2), Point(1, 6, 2), Point(1, 7, 2)])
solve = HawaSolve(Case=case, Device=backend, TargetSteps=target_iterations, Run=run_pause, Reset=reset)  # -> Solution, State, Steps, Monitor
horizontal_slice_index = Slider(4, range=0..16)

# ---- group: 06 / RESULTS / CONTROLS
panel = Panel(solve.Monitor)
slice = HawaSlice(Solution=solve.Solution, Axis=2, Index=horizontal_slice_index, Field="speed", Mean=False)  # -> Mesh, Values, Range, Valid
streamlines = HawaStreamlines(Solution=solve.Solution, Seeds=streamline_seeds_edit_points, Steps=100)

# ---- group: 07 / RESULTS / CONTROLS
speed_color_range_m_s = Panel(slice.Range)
