# Grasshopper definition 09-parametric-hull-galapagos.gh (Grasshopper 1.0.8)
# plug-ins: Hawa

# ---- group: 01 / SHAPE GENES + FIXED VOLUME
# HAWA / PARAMETRIC HULL + GALAPAGOS
# A closed canoe hull in single phase flow. Length = 8 m; mesh volume = 6 m³. No waves, free surface, buoyancy or boat motion.
# 1 Change the three shape sliders.  2 Enable evaluation.  3 Double-click Galapagos; minimize fitness; start the solver.
# Each candidate starts fresh and completes the same iteration count. Fitness is mean X momentum exchange / (0.5 rho U² V^(2/3)).
# The coarse grid and viscous fluid keep this example small. Refine the grid and check duration before comparing engineering designs.
bow_fullness = Slider(0.896, range=0.4..1.6)
stern_fullness = Slider(1.461, range=0.4..1.6)
beam_draft = Slider(2.586, range=1..3)
fixed_length_m = Slider(8, range=6..10)
fixed_volume_m³ = Slider(6, range=4..8)
hull_color = ColourSwatch(SwatchColor=RGB(174, 202, 207))
hull = HawaParametricHull(
    Length=fixed_length_m,
    Volume=fixed_volume_m³,
    BowFullness=bow_fullness,
    SternFullness=stern_fullness,
    BeamDraft=beam_draft,
    DeckCenter=Point(8, 6.1, 5.1))  # -> Hull, Sections, Volume, Dimensions
panel = Panel(hull.Dimensions)
preview = CustomPreview(Geometry=hull.Hull, Material=hull_color)

# ---- group: 05 / SEARCH THE SHAPE
# GALAPAGOS
# Genome: Bow, Stern, Beam / draft.
# Fitness: completed Hawa Evaluate output.
# Minimize. Population 10; time limit 2 min.
# Enable evaluation before Start Solver.
# Stop, choose a genome, then Reinstate.
# The last candidate is cached; shape changes rerun CFD.
minimize_hull_resistance = Galapagos(fitness=evaluate, gene=[bow_fullness, stern_fullness, beam_draft])

# ---- group: 02 / FIXED TANK + FLUID
fixed_tank_meters = Box({Plane=PlaneXY(0, 0, 0), X=Domain(0, 24), Y=Domain(0, 12), Z=Domain(0, 10)})
cell_size_m = Slider(0.4, range=0.25..1)
flow_speed_m_s = Slider(1, range=0.5..2)
viscosity_m²_s = Slider(0.1, range=0.05..0.2)
domain = HawaDomain(Box=fixed_tank_meters, CellSize=cell_size_m, LengthUnits="meters")  # -> Domain, Bounds, Grid
physics = HawaPhysics(Speed=flow_speed_m_s, Viscosity=viscosity_m²_s, Density=1000, Collision="regularized", LatticeMach=0.05)
boundary = HawaBoundaries(X="inlet", X_2="outlet", Y="slip", Y_2="slip", Z="slip", Z_2="slip")
geometry = HawaGeometry(Domain=domain.Domain, Obstacles=hull.Hull)  # -> Geometry, SolidCells
case = HawaCase(Domain=domain.Domain, Geometry=geometry.Geometry, Physics=physics, Boundaries=boundary)

# ---- group: 03 / COMPLETE EACH CANDIDATE
backend = ValueList({"auto", "mps", "cuda:0", "cpu"}, selected="auto")
iterations_per_candidate = Slider(200, range=40..2000)
final_averaging_window = Slider(20, range=5..100)
enable_evaluation = BooleanToggle(True)
evaluate = HawaEvaluate(
    Case=case,
    Device=backend,
    Iterations=iterations_per_candidate,
    AverageWindow=final_averaging_window,
    ReferenceVolume=fixed_volume_m³,
    Enable=enable_evaluation)  # -> Fitness, Solution, Resistance, Report
panel_2 = Panel(evaluate.Report)

# ---- group: 04 / FITNESS + FLOW
upstream_seeds = Point([Point(2, 4, 4), Point(2, 4.5, 4), Point(2, 5, 4), Point(2, 5.5, 4), Point(2, 6, 4), Point(2, 6.5, 4), Point(2, 7, 4), Point(2, 7.5, 4), Point(2, 8, 4)])
fitness_minimize = Panel(evaluate.Fitness)
slice = HawaSlice(Solution=evaluate.Solution, Axis=2, Index=8, Field="speed", Mean=False)  # -> Mesh, Values, Range, Valid
streamlines = HawaStreamlines(Solution=evaluate.Solution, Seeds=upstream_seeds, Steps=100)
