# Grasshopper definition 10-responsive-hull-search.gh (Grasshopper 1.0.8)
# plug-ins: MeshEdit Components, Hawa

# ---- group: 01 / INPUTS
# Hawa guide / purpose: HAWA / 10
# Responsive hull search
# 
# Enable evaluation and Run search. Pause holds the current candidate; disabling cancels. Hull geometry is an editable assembly of native GH expressions, points, mesh faces, volume measurement and transforms. Replace it with your own mesh; no Hawa hull node is required.
station_t_example_topology = Number([0.025, 0.025, 0.025, 0.025, 0.025, 0.025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])
fixed_tank_meters = Box({Plane=PlaneXY(0, 0, 0), X=Domain(0, 24), Y=Domain(0, 12), Z=Domain(0, 10)})
bow_fullness = Slider(0.8, range=0.4..1.6)
stern_fullness = Slider(0.8, range=0.4..1.6)
cell_size_m = Slider(0.4, range=0.25..1)

# ---- group: 02 / DOMAIN / PHYSICS
# Hawa guide / operation: START / PAUSE / RESET
# Read left to right. Inputs and controls are at the left; results are at the right.
# 
# Save a copy before editing. Wait for preparation. Enable Run only when ready. Solve: Run false pauses; Reset clears state. Evaluate/Search/Record: disabling cancels.
# 
# For recordings, set a new absolute directory before starting.
bow_stern_taper = Expression(x=station_t_example_topology, y=bow_fullness, z=stern_fullness, Expression="Sin(pi*x)^if(x<0.5,y,z)")
ring_cos_example_topology = Number([1, 0.9914448614, 0.9659258263, 0.9238795325, 0.8660254038, 0.7933533403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])
domain = HawaDomain(Box=fixed_tank_meters, CellSize=cell_size_m, LengthUnits="meters")  # -> Domain, Bounds, Grid

# ---- group: 03 / DOMAIN / PHYSICS
ring_sin_example_topology = Number([0, 0.1305261922, 0.2588190451, 0.3826834324, 0.5, 0.608761429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])
section_half_width = Expression(x=bow_stern_taper, y=ring_cos_example_topology, Expression="x*y")
bounds = HawaDomainPreview(Domain=domain.Domain)  # -> Edges, FaceCenters, Labels
beam_draft = Slider(2, range=1..3)
fixed_length_m = Slider(8, range=6..10)

# ---- group: 04 / RESULTS / CONTROLS
# Hawa guide / limits: CHECK THE RESULT
# Single fluid, submerged hull. No waves or buoyancy. Short scores demonstrate search; they do not establish an optimum.
# 
# Use the case report and component messages. Compare physical time and fixed colour ranges.
# 
# Examples and MCP instructions: README.md and ../../docs/agents/rhino-mcp.md
longitudinal_coordinate = Expression(x=fixed_length_m, y=station_t_example_topology, Expression="x*(y-0.5)")
beam_draft_ratio = Expression(x=section_half_width, y=beam_draft, Expression="x*y*0.5")
section_depth = Expression(x=bow_stern_taper, y=ring_sin_example_topology, Expression="-x*y")

# ---- group: 05 / RESULTS / CONTROLS
closed_hull_topology_example_data = MeshFace([{A=0, B=25, C=26, D=1}, {A=1, B=26, C=27, D=2}, {A=2, B=27, C=28, D=3}, {A=3, B=28, C=29, D=4}, {A=4, B=29, C=30, D=5}, {A=5, B=30, C=31, D=6}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])
hull_vertices = ConstructPoint(XCoordinate=longitudinal_coordinate, YCoordinate=beam_draft_ratio, ZCoordinate=section_depth)

# ---- group: 06 / RESULTS / CONTROLS
close_station_mesh = ConstructMesh(Vertices=hull_vertices, Faces=closed_hull_topology_example_data)

# ---- group: 07 / RESULTS / CONTROLS
measure_raw_volume = MeshVolume(Mesh=close_station_mesh)  # -> Volume, Centroid
fixed_volume_m³ = Slider(6, range=4..8)

# ---- group: 08 / RESULTS / CONTROLS
match_target_volume = Expression(x=fixed_volume_m³, y=measure_raw_volume.Volume, Expression="Sqrt(x/Abs(y))")

# ---- group: 09 / RESULTS / CONTROLS
deck_center_m = Vector(Vector(8, 6.1, 5.1))
scale_section_yz = ScaleNU(Geometry=close_station_mesh, Plane=PlaneXY(0, 0, 0), ScaleX=1, ScaleY=match_target_volume, ScaleZ=match_target_volume)  # -> Geometry, Transform

# ---- group: 10 / RESULTS / CONTROLS
position_example_hull = Move(Geometry=scale_section_yz.Geometry, Motion=deck_center_m)  # -> Geometry, Transform
hull_color = ColourSwatch(SwatchColor=RGB(174, 202, 207))
flow_speed_m_s = Slider(1, range=0.5..2)
viscosity_m²_s = Slider(0.1, range=0.05..0.2)

# ---- group: 11 / GEOMETRY
physics = HawaPhysics(Speed=flow_speed_m_s, Viscosity=viscosity_m²_s, Density=1000, Collision="regularized", LatticeMach=0.05)
boundary = HawaBoundaries(X="inlet", X_2="outlet", Y="slip", Y_2="slip", Z="slip", Z_2="slip")
geometry = HawaGeometry(Domain=domain.Domain, Obstacles=position_example_hull.Geometry, CurvedWalls=False)  # -> Geometry, SolidCells
closed_mesh_volume_m³ = MeshVolume(Mesh=position_example_hull.Geometry)  # -> Volume, Centroid
preview = CustomPreview(Geometry=position_example_hull.Geometry, Material=hull_color)

# ---- group: 12 / BUILD CASE
backend = ValueList({"auto", "mps", "cuda:0", "cpu"}, selected="auto")
measured_mesh_volume_m³ = Panel(closed_mesh_volume_m³.Volume)
case = HawaCase(Domain=domain.Domain, Geometry=geometry.Geometry, Physics=physics, Boundaries=boundary)
iterations_per_candidate = Slider(200, range=40..2000)
final_averaging_window = Slider(20, range=5..100)
run_search = BooleanToggle(False)
pause = BooleanToggle(False)
cancel_evaluation = BooleanToggle(False)

# ---- group: 13 / RUN / CONTROL
upstream_seeds = Point([Point(2, 4, 4), Point(2, 4.5, 4), Point(2, 5, 4), Point(2, 5.5, 4), Point(2, 6, 4), Point(2, 6.5, 4), Point(2, 7, 4), Point(2, 7.5, 4), Point(2, 8, 4)])
evaluate = HawaEvaluate(
    Case=case,
    Device=backend,
    Iterations=iterations_per_candidate,
    AverageWindow=final_averaging_window,
    ReferenceVolume=fixed_volume_m³,
    Enable=run_search,
    Pause=pause,
    Cancel=cancel_evaluation)  # -> Fitness, Solution, Resistance, Report, Candidate
candidate_budget = Slider(5, range=2..20)

# ---- group: 14 / RESULTS / CONTROLS
fitness_minimize = Panel(evaluate.Fitness)
panel = Panel(evaluate.Report)
search = HawaSearch(
    Genes=[bow_fullness, stern_fullness, beam_draft],
    Fitness=evaluate.Fitness,
    Candidate=evaluate.Candidate,
    Run=run_search,
    Pause=pause,
    Budget=candidate_budget,
    Mutation=0.15,
    RestoreBest=False)  # -> BestFitness, BestGenes, History, State
slice = HawaSlice(Solution=evaluate.Solution, Axis=2, Index=8, Field="speed", Mean=False)  # -> Mesh, Values, Range, Valid
streamlines = HawaStreamlines(Solution=evaluate.Solution, Seeds=upstream_seeds, Steps=100)

# ---- group: 15 / RESULTS / CONTROLS
panel_2 = Panel(search.History)
