# Grasshopper definition 12-local-airfoil-rc-wing.gh (Grasshopper 1.0.8)
# plug-ins: Hawa

# ---- group: 01 / INPUTS
# Hawa guide / purpose: HAWA / 12
# Local airfoil and RC wing
# 
# Choose an offline NACA code or local coordinate file. Edit wing span/chord. Load your own local polar.
panel = Panel("data/naca0012.dat")
panel_2 = Panel("data/polar-format.csv")
span = Slider(2, range=1..4)
root_chord = Slider(0.3, range=0.1..0.8)
tip_chord = Slider(0.15, range=0.05..0.6)
tip_twist = Slider(-2, range=-8..4)
angle_of_attack = Slider(4, range=-6..10)

# ---- group: 02 / GEOMETRY
polar = HawaPolarData(File=panel_2, Reynolds=100000, Mach=0, Angle=angle_of_attack)  # -> Polar, Cl, Cd, LiftCurve, DragPolar, Conditions, Cm, LiftDrag
llt = HawaWingAnalysis(Span=span, RootChord=root_chord, TipChord=tip_chord, Angle=angle_of_attack, Twist=tip_twist, ZeroLiftAngle=0)  # -> CL, CDi, SpanLoads, Scope, ProfileDrag, TotalDrag
# Hawa guide / operation: START / PAUSE / RESET
# Read left to right. Inputs and controls are at the left; results are at the right.
# 
# Save a copy before editing. Wait for preparation. Enable Run only when ready. Solve: Run false pauses; Reset clears state. Evaluate/Search/Record: disabling cancels.
# 
# For recordings, set a new absolute directory before starting.
airfoil = HawaAirfoil(NACAOrFile=panel, Chord=1, Plane=PlaneXY(0, 0, 0))  # -> Profile, Airfoil, Source

# ---- group: 03 / GEOMETRY
cl = Panel(llt.CL)
cdi = Panel(llt.CDi)
panel_3 = Panel(llt.Scope)
section_cm = Panel(polar.Cm)
# Hawa guide / limits: CHECK THE RESULT
# The bundled polar is synthetic format data. Lifting-line results assume attached flow; stall is not predicted.
# 
# Use the case report and component messages. Compare physical time and fixed colour ranges.
# 
# Examples and MCP instructions: README.md and ../../docs/agents/rhino-mcp.md
wing = HawaWing(Airfoil=airfoil.Airfoil, Span=span, RootChord=root_chord, TipChord=tip_chord, Twist=tip_twist)  # -> Wing, Sections
