# Grasshopper definition 13-record-and-playback.gh (Grasshopper 1.0.8)
# plug-ins: Hawa

# ---- group: 01 / INPUTS
panel = Panel("Choose a new recording directory")
# Hawa guide / purpose: HAWA / 13
# Record and replay
# 
# Choose a new absolute output directory. Start Record, wait for completion, then change Frame.
example = HawaExample(Example="tgv3d-bgk", Size=16)
record = BooleanToggle(False)
pause = BooleanToggle(False)

# ---- group: 02 / RUN / CONTROL
# Hawa guide / operation: START / PAUSE / RESET
# Read left to right. Inputs and controls are at the left; results are at the right.
# 
# Save a copy before editing. Wait for preparation. Enable Run only when ready. Solve: Run false pauses; Reset clears state. Evaluate/Search/Record: disabling cancels.
# 
# For recordings, set a new absolute directory before starting.
record_2 = HawaRecord(Case=example, Directory=panel, Steps=200, Interval=10, Device="auto", Run=record, Pause=pause)  # -> Manifest, State, Solution
frame = Slider(0, range=0..20)

# ---- group: 03 / CAPTURE / PLAYBACK
# Hawa guide / limits: CHECK THE RESULT
# Recording creates files. Use a new directory for each run. Playback must use the returned manifest.
# 
# Use the case report and component messages. Compare physical time and fixed colour ranges.
# 
# Examples and MCP instructions: README.md and ../../docs/agents/rhino-mcp.md
panel_2 = Panel(record_2.State)
playback = HawaPlayback(Manifest=record_2.Manifest, Index=frame)  # -> Frame, Time

# ---- group: 04 / RESULTS / CONTROLS
iso = HawaIsosurface(Frame=playback.Frame, Field="speed", Level=0.5, Stride=2)
