# Grasshopper definition 15-fixed-refinement.gh (Grasshopper 1.0.8)
# plug-ins: Hawa

# ---- group: 01 / INPUTS
# Hawa guide / purpose: HAWA / 15
# Fixed refinement patch
# 
# Edit the domain and interior patch; run both grids and compare their field planes.
box = Box({Plane=PlaneXY(0, 0, 0), X=Domain(0, 16), Y=Domain(0, 16), Z=Domain(0, 16)})

# ---- group: 02 / DOMAIN / PHYSICS
# Hawa guide / operation: START / PAUSE / RESET
# Read left to right. Inputs and controls are at the left; results are at the right.
# 
# Save a copy before editing. Wait for preparation. Enable Run only when ready. Solve: Run false pauses; Reset clears state. Evaluate/Search/Record: disabling cancels.
# 
# For recordings, set a new absolute directory before starting.
domain = HawaDomain(Box=box, CellSize=1, LengthUnits="meters")  # -> Domain, Bounds, Grid
box_2 = Box({Plane=PlaneXY(0, 0, 0), X=Domain(4, 12), Y=Domain(4, 12), Z=Domain(4, 12)})

# ---- group: 03 / DOMAIN / PHYSICS
# Hawa guide / limits: CHECK THE RESULT
# One fixed 2:1 BGK patch. Keep interpolation stencils in fluid. No automatic adaptive mesh.
# 
# Use the case report and component messages. Compare physical time and fixed colour ranges.
# 
# Examples and MCP instructions: README.md and ../../docs/agents/rhino-mcp.md
patch = HawaRefinementPatch(Parent=domain.Domain, Region=box_2)  # -> FineDomain, Bounds
bounds = HawaDomainPreview(Domain=domain.Domain)  # -> Edges, FaceCenters, Labels
mesh = Mesh(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)

# ---- group: 04 / GEOMETRY
physics = HawaPhysics(Speed=1, Viscosity=1, Density=1.225, Collision="bgk", LatticeMach=0.05)
geometry = HawaGeometry(Domain=domain.Domain, Obstacles=mesh, CurvedWalls=False)  # -> Geometry, SolidCells
geometry_2 = HawaGeometry(Domain=patch.FineDomain, Obstacles=mesh, CurvedWalls=False)  # -> Geometry, SolidCells
bounds_2 = HawaDomainPreview(Domain=patch.FineDomain)  # -> Edges, FaceCenters, Labels

# ---- group: 05 / BUILD CASE
case = HawaCase(Domain=domain.Domain, Geometry=geometry.Geometry, Physics=physics)
case_2 = HawaCase(Domain=patch.FineDomain, Geometry=geometry_2.Geometry, Physics=physics)
run_cancel = BooleanToggle(False)
pause = BooleanToggle(False)

# ---- group: 06 / RUN / CONTROL
refine = HawaRefinedSolve(CoarseCase=case, FineCase=case_2, Steps=200, Device="auto", Run=run_cancel, Pause=pause)  # -> CoarseFrame, FineFrame, State, Report
colors = HawaColorMap(Palette="blue-green", Minimum=0, Maximum=1.6, Units="m/s")  # -> Map, Colors, Labels
rec = Rectangle({Plane=PlaneXY(0, 0, 7.98), Size=Domain2(u=0..16, v=0..16)})
rec_2 = Rectangle({Plane=PlaneXY(4, 4, 8), Size=Domain2(u=0..8, v=0..8)})

# ---- group: 07 / RESULTS / CONTROLS
panel = Panel(refine.Report)
plane = HawaPlaneField(Frame=refine.CoarseFrame, Rectangle=rec, Resolution=30, Field="speed", Colors=colors.Map)  # -> Mesh, Contours, Values
plane_2 = HawaPlaneField(Frame=refine.FineFrame, Rectangle=rec_2, Resolution=30, Field="speed", Colors=colors.Map)  # -> Mesh, Contours, Values
