# Grasshopper definition 16-cylinder-wake-recording.gh (Grasshopper 1.0.8)
# plug-ins: Hawa

# ---- group: 01 / INPUTS
# Hawa guide / purpose: HAWA / 16
# Cylinder wake recording
# 
# Set a new absolute directory, then record the wake. Pause/resume or cancel. Replay saved frames.
box = Box({Plane=PlaneXY(0, 0, 0), X=Domain(0, 24), Y=Domain(0, 12), Z=Domain(0, 0.45)})

# ---- group: 02 / DOMAIN / PHYSICS
# Hawa guide / operation: START / PAUSE / RESET
# Read left to right. Inputs and controls are at the left; results are at the right.
# 
# Save a copy before editing. Wait for preparation. Enable Run only when ready. Solve: Run false pauses; Reset clears state. Evaluate/Search/Record: disabling cancels.
# 
# For recordings, set a new absolute directory before starting.
domain = HawaDomain(Box=box, CellSize=0.15, LengthUnits="meters")  # -> Domain, Bounds, Grid
mesh = Mesh(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)

# ---- group: 03 / GEOMETRY
physics = HawaPhysics(Speed=1, Viscosity=0.02, Density=1.225, Collision="bgk", LatticeMach=0.1)
boundary = HawaBoundaries(X="inlet", X_2="outlet", Y="periodic", Y_2="periodic", Z="periodic", Z_2="periodic")
# Hawa guide / limits: CHECK THE RESULT
# The full recording runs 8000 steps. Use a smaller trial first. Outlet and domain size affect the wake.
# 
# Use the case report and component messages. Compare physical time and fixed colour ranges.
# 
# Examples and MCP instructions: README.md and ../../docs/agents/rhino-mcp.md
geometry = HawaGeometry(Domain=domain.Domain, Obstacles=mesh, CurvedWalls=False)  # -> Geometry, SolidCells
bounds = HawaDomainPreview(Domain=domain.Domain)  # -> Edges, FaceCenters, Labels

# ---- group: 04 / BUILD CASE
panel = Panel("Choose a new absolute recording directory")
case = HawaCase(Domain=domain.Domain, Geometry=geometry.Geometry, Physics=physics, Boundaries=boundary)
record_cancel = BooleanToggle(False)
pause = BooleanToggle(False)

# ---- group: 05 / RUN / CONTROL
record = HawaRecord(Case=case, Directory=panel, Steps=8000, Interval=100, Device="auto", Run=record_cancel, Pause=pause)  # -> Manifest, State, Solution
box_2 = Box({Plane=PlaneXY(0, 0, 0), X=Domain(1, 2), Y=Domain(1, 11), Z=Domain(0.1, 0.3)})
frame = Slider(0, range=0..80)

# ---- group: 06 / CAPTURE / PLAYBACK
playback = HawaPlayback(Manifest=record.Manifest, Index=frame)  # -> Frame, Time
colors = HawaColorMap(Palette="blue-green", Minimum=0, Maximum=1.6, Units="m/s")  # -> Map, Colors, Labels
seeds = HawaSeedPoints(Box=box_2, XCount=2, YCount=8, ZCount=8)
rec = Rectangle({Plane=PlaneXY(0, 0, 0.15), Size=Domain2(u=0..24, v=0..12)})

# ---- group: 07 / RESULTS / CONTROLS
plane = HawaPlaneField(Frame=playback.Frame, Rectangle=rec, Resolution=80, Field="speed", Colors=colors.Map)  # -> Mesh, Contours, Values
flow = HawaFlowDisplay(Frame=playback.Frame, Seeds=seeds, Colors=colors.Map, Field="speed", Steps=150, Radius=0.03, Backward=False)  # -> Lines, Tubes
