# Grasshopper definition 17-oscillating-cylinder.gh (Grasshopper 1.0.8)
# plug-ins: Hawa

# ---- group: 01 / INPUTS
# Hawa guide / purpose: HAWA / 17
# Oscillating cylinder
# 
# Set travel amplitude in metres. Run the case; inspect the shared field snapshot and moved body.
box = Box({Plane=PlaneXY(0, 0, 0), X=Domain(0, 8), Y=Domain(0, 6), Z=Domain(0, 4)})

# ---- group: 02 / DOMAIN / PHYSICS
# Hawa guide / operation: START / PAUSE / RESET
# Read left to right. Inputs and controls are at the left; results are at the right.
# 
# Save a copy before editing. Wait for preparation. Enable Run only when ready. Solve: Run false pauses; Reset clears state. Evaluate/Search/Record: disabling cancels.
# 
# For recordings, set a new absolute directory before starting.
domain = HawaDomain(Box=box, CellSize=0.25, LengthUnits="meters")  # -> Domain, Bounds, Grid
physics = HawaPhysics(Speed=1, Viscosity=0.05, Density=1.225, Collision="bgk", LatticeMach=0.04)
travel_amplitude_m = Slider(0.25, range=0.02..0.3)

# ---- group: 03 / BUILD CASE
oscillate = HawaOscillation(Axis=Vector(0, 1, 0), Amplitude=travel_amplitude_m, Ramp=0.5, Frequency=0.5, Angular=False, Phase=0)
# Hawa guide / limits: CHECK THE RESULT
# Prescribed motion, uniform BGK. Keep the full trajectory two cells from domain faces. Check grids and cycle averages.
# 
# Use the case report and component messages. Compare physical time and fixed colour ranges.
# 
# Examples and MCP instructions: README.md and ../../docs/agents/rhino-mcp.md
case = HawaCase(Domain=domain.Domain, Physics=physics)
bounds = HawaDomainPreview(Domain=domain.Domain)  # -> Edges, FaceCenters, Labels
pt = Point(Point(3, 3, 2))
mesh = Mesh(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)

# ---- group: 04 / PREPARE BODY
body = HawaMovingBody(Case=case, Mesh=mesh, Motion=oscillate, Pivot=pt, BodyID="body")  # -> Body, Report

# ---- group: 05 / BUILD CASE
panel = Panel("Choose a new absolute recording directory")
motioncase = HawaMotionCase(Case=case, Bodies=body.Body)
run_pause = BooleanToggle(False)
record_cancel = BooleanToggle(False)

# ---- group: 06 / RUN / CONTROL
record = HawaRecord(Case=motioncase, Directory=panel, Steps=200, Interval=10, Device="auto", Run=record_cancel, Pause=False)  # -> Manifest, State, Solution
check = HawaCheckCase(Case=motioncase)  # -> Valid, Report
solve = HawaSolve(Case=motioncase, Device="auto", TargetSteps=300, Run=run_pause, Reset=False)  # -> Solution, State, Steps, Monitor
frame = Slider(0, range=0..20)

# ---- group: 07 / CAPTURE / PLAYBACK
frame_2 = HawaFieldSnapshot(Solution=solve.Solution, Mean=False)  # -> Frame, Time
playback = HawaPlayback(Manifest=record.Manifest, Index=frame)  # -> Frame, Time
colors = HawaColorMap(Palette="blue-green", Minimum=0, Maximum=1.8, Units="m/s")  # -> Map, Colors, Labels
rec = Rectangle({Plane=PlaneXY(0, 0, 2), Size=Domain2(u=0..8, v=0..6)})

# ---- group: 08 / FIELDS / LOADS
plane = HawaPlaneField(Frame=frame_2.Frame, Rectangle=rec, Resolution=30, Field="speed", Colors=colors.Map)  # -> Mesh, Contours, Values
loads = HawaBodyLoads(SolutionOrFrame=frame_2.Frame)  # -> Force, Torque, Power, BodyIDs, MotionState
loads_2 = HawaBodyLoads(SolutionOrFrame=playback.Frame)  # -> Force, Torque, Power, BodyIDs, MotionState

# ---- group: 09 / BODY / OUTPUT
fluid_power_w = Panel(loads.Power)
bodyview = HawaBodyPreview(ReferenceMesh=mesh, MotionState=loads.MotionState, BodyID="body")
bodyview_2 = HawaBodyPreview(ReferenceMesh=mesh, MotionState=loads_2.MotionState, BodyID="body")
