# Grasshopper definition 24-boundary-flow-transfer.gh (Grasshopper 1.0.8)
# plug-ins: Hawa

# ---- group: 01 / INPUTS
colors = HawaColorMap(Palette="blue-green", Minimum=0, Maximum=1.5, Units="m/s")  # -> Map, Colors, Labels
# Hawa guide / purpose: HAWA / 24
# Boundary flow transfer between uniform grids
# 
# Record a coarse parent block wake, map its time-varying velocity onto a finer child inlet, then run the child. Set new absolute recording and boundary paths. Enable controls in order: Record parent, Capture inlet, Run child. Parent 60 steps and child 120 steps cover the same physical duration.
box = Box({Plane=PlaneXY(0, 0, 0), X=Domain(0, 3.2), Y=Domain(0, 1.6), Z=Domain(0, 1.6)})
box_2 = Box({Plane=PlaneXY(0, 0, 0), X=Domain(1.2, 2.4), Y=Domain(0.2, 1.4), Z=Domain(0.2, 1.4)})

# ---- group: 02 / DOMAIN / PHYSICS
# Hawa guide / operation: START / PAUSE / RESET
# Read left to right. Inputs and controls are at the left; results are at the right.
# 
# Save a copy before editing. Wait for preparation. Enable Run only when ready. Solve: Run false pauses; Reset clears state. Evaluate/Search/Record: disabling cancels.
# 
# For recordings, set a new absolute directory before starting.
domain = HawaDomain(Box=box, CellSize=0.2, LengthUnits="meters")  # -> Domain, Bounds, Grid
domain_2 = HawaDomain(Box=box_2, CellSize=0.1, LengthUnits="meters")  # -> Domain, Bounds, Grid
legend = HawaLegend(Map=colors.Map, Plane=PlaneXY(3.4, 0, 0), Height=1)  # -> Legend, Labels, Locations
mesh = Mesh(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)

# ---- group: 03 / GEOMETRY
physics = HawaPhysics(Speed=1, Viscosity=0.1, Density=1.225, Collision="regularized", LatticeMach=0.03)
boundary = HawaBoundaries(X="inlet", X_2="outlet", Y="periodic", Y_2="periodic", Z="periodic", Z_2="periodic")
# Hawa guide / limits: CHECK THE RESULT
# Experimental equilibrium velocity inlet; periodic transverse faces only. Demonstration viscosity. Quality checks sampled Mach/density; they do not prove convergence or atmospheric accuracy. Missing/solid samples, backflow, stale hashes and time extrapolation are rejected.
# 
# Use the case report and component messages. Compare physical time and fixed colour ranges.
# 
# Examples and MCP instructions: README.md and ../../docs/agents/rhino-mcp.md
geometry = HawaGeometry(Domain=domain.Domain, Obstacles=mesh, CurvedWalls=False)  # -> Geometry, SolidCells
bounds = HawaDomainPreview(Domain=domain.Domain)  # -> Edges, FaceCenters, Labels
bounds_2 = HawaDomainPreview(Domain=domain_2.Domain)  # -> Edges, FaceCenters, Labels

# ---- group: 04 / BUILD CASE
panel = Panel("SET_NEW_ABSOLUTE_PARENT_DIRECTORY")
case = HawaCase(Domain=domain.Domain, Geometry=geometry.Geometry, Physics=physics, Boundaries=boundary)
_1_record_parent = BooleanToggle(False)

# ---- group: 05 / RUN / CONTROL
panel_2 = Panel("SET_NEW_ABSOLUTE_BOUNDARY_FILE.npz")
record = HawaRecord(Case=case, Directory=panel, Steps=60, Interval=5, Device="mps", Run=_1_record_parent, Pause=False)  # -> Manifest, State, Solution
case_2 = HawaCase(Domain=domain_2.Domain, Physics=physics, Boundaries=boundary)
_2_capture_inlet = BooleanToggle(False)

# ---- group: 06 / CAPTURE / PLAYBACK
slice = HawaSlice(Solution=record.Solution, Axis=2, Index=4, Field="speed", Mean=False)  # -> Mesh, Values, Range, Valid
capture_bc = HawaBoundaryCapture(ParentRecording=record.Manifest, ChildCase=case_2, NewBoundaryFile=panel_2, Capture=_2_capture_inlet)  # -> MappedCase, BoundaryFile, Report
frame = HawaFieldSnapshot(Solution=record.Solution, Mean=False)  # -> Frame, Time
quality = HawaResultQuality(Solution=record.Solution)  # -> Quality, TransferEligible, Report

# ---- group: 07 / RESULTS / CONTROLS
panel_3 = Panel(quality.Report)
read_bc = HawaBoundaryData(BoundaryFile=capture_bc.BoundaryFile, ChildCase=case_2, Reload=0)  # -> MappedCase, Report
plane = HawaPlaneField(
    Frame=frame.Frame,
    Rectangle={Plane=PlaneXY(0, 0, 0.8), Size=Domain2(u=0..3.2, v=0..1.6)},
    Resolution=30,
    Field="speed",
    Colors=colors.Map)  # -> Mesh, Contours, Values
_3_run_child = BooleanToggle(False)
reset_child = BooleanToggle(False)

# ---- group: 08 / RUN / CONTROL
solve = HawaSolve(Case=read_bc.MappedCase, Device="mps", TargetSteps=120, Run=_3_run_child, Reset=reset_child)  # -> Solution, State, Steps, Monitor

# ---- group: 09 / CAPTURE / PLAYBACK
slice_2 = HawaSlice(Solution=solve.Solution, Axis=2, Index=6, Field="speed", Mean=False)  # -> Mesh, Values, Range, Valid
frame_2 = HawaFieldSnapshot(Solution=solve.Solution, Mean=False)  # -> Frame, Time
quality_2 = HawaResultQuality(Solution=solve.Solution)  # -> Quality, TransferEligible, Report

# ---- group: 10 / RESULTS / CONTROLS
panel_4 = Panel(quality_2.Report)
plane_2 = HawaPlaneField(
    Frame=frame_2.Frame,
    Rectangle={Plane=PlaneXY(1.2, 0.2, 0.8), Size=Domain2(u=0..1.2, v=0..1.2)},
    Resolution=30,
    Field="speed",
    Colors=colors.Map)  # -> Mesh, Contours, Values
