# Grasshopper definition 26-bidirectional-open-faces.gh (Grasshopper 1.0.8)
# plug-ins: Hawa

# ---- group: 01 / INPUTS
colors = HawaColorMap(Palette="blue-green", Minimum=0, Maximum=0.3, Units="m/s")  # -> Map, Colors, Labels
# Hawa guide / purpose: HAWA / 26
# Bidirectional flow on Y faces
# 
# Y- and Y+ use open conditions with specified incoming exterior velocities. Initial velocity on Boundary Set is (0,-0.2,0) m/s. Pause, change it to (0,0.2,0), then run the new case to reverse the demonstration. Other faces are periodic.
box = Box({Plane=PlaneXY(0, 0, 0), X=Domain(0, 2), Y=Domain(0, 1), Z=Domain(0, 0.8)})

# ---- group: 02 / DOMAIN / PHYSICS
# Hawa guide / operation: START / PAUSE / RESET
# Read left to right. Inputs and controls are at the left; results are at the right.
# 
# Save a copy before editing. Wait for preparation. Enable Run only when ready. Solve: Run false pauses; Reset clears state. Evaluate/Search/Record: disabling cancels.
# 
# For recordings, set a new absolute directory before starting.
domain = HawaDomain(Box=box, CellSize=0.1, LengthUnits="meters")  # -> Domain, Bounds, Grid
physics = HawaPhysics(Speed=1, Viscosity=0.1, Density=1.225, Collision="smagorinsky-v1", LatticeMach=0.03)
legend = HawaLegend(Map=colors.Map, Plane=PlaneXY(2.2, 0, 0), Height=0.7)  # -> Legend, Labels, Locations

# ---- group: 03 / BUILD CASE
# Hawa guide / limits: CHECK THE RESULT
# Open conditions switch using the interior normal velocity: incoming velocity or outgoing pressure. They can reflect disturbances. Adjacent open faces are not qualified. No atmospheric turbulence or rough-wall model.
# 
# Use the case report and component messages. Compare physical time and fixed colour ranges.
# 
# Examples and MCP instructions: README.md and ../../docs/agents/rhino-mcp.md
hawa_boundary_patch = HawaBoundaryPatch(Face="x-", Condition="periodic", Velocity=Vector(0, 0, 0), Pressure=0, Profile="uniform", ProfileAxis=1)
case = HawaCase(Domain=domain.Domain, Physics=physics)
hawa_boundary_patch_2 = HawaBoundaryPatch(Face="x+", Condition="periodic", Velocity=Vector(0, 0, 0), Pressure=0, Profile="uniform", ProfileAxis=1)
hawa_boundary_patch_3 = HawaBoundaryPatch(Face="y-", Condition="open", Velocity=Vector(0, 0.2, 0), Pressure=0, Profile="uniform", ProfileAxis=1)
hawa_boundary_patch_4 = HawaBoundaryPatch(Face="y+", Condition="open", Velocity=Vector(0, -0.2, 0), Pressure=0, Profile="uniform", ProfileAxis=1)
bounds = HawaDomainPreview(Domain=domain.Domain)  # -> Edges, FaceCenters, Labels
hawa_boundary_patch_5 = HawaBoundaryPatch(Face="z-", Condition="periodic", Velocity=Vector(0, 0, 0), Pressure=0, Profile="uniform", ProfileAxis=1)
hawa_boundary_patch_6 = HawaBoundaryPatch(Face="z+", Condition="periodic", Velocity=Vector(0, 0, 0), Pressure=0, Profile="uniform", ProfileAxis=1)

# ---- group: 04 / RESULTS / CONTROLS
boundary_set = HawaBoundarySet(
    Case=case,
    Patches=[hawa_boundary_patch, hawa_boundary_patch_2, hawa_boundary_patch_3, hawa_boundary_patch_4, hawa_boundary_patch_5, hawa_boundary_patch_6],
    InitialVelocity=Vector(0, -0.2, 0))  # -> Case, Plan
run = BooleanToggle(False)
reset = BooleanToggle(False)

# ---- group: 05 / RUN / CONTROL
solve = HawaSolve(Case=boundary_set.Case, Device="mps", TargetSteps=400, Run=run, Reset=reset)  # -> Solution, State, Steps, Monitor

# ---- group: 06 / CAPTURE / PLAYBACK
frame = HawaFieldSnapshot(Solution=solve.Solution, Mean=False)  # -> Frame, Time
quality = HawaResultQuality(Solution=solve.Solution)  # -> Quality, TransferEligible, Report

# ---- group: 07 / RESULTS / CONTROLS
plane = HawaPlaneField(
    Frame=frame.Frame,
    Rectangle={Plane=PlaneXY(0, 0, 0.4), Size=Domain2(u=0..2, v=0..1)},
    Resolution=30,
    Field="speed",
    Colors=colors.Map)  # -> Mesh, Contours, Values
panel = Panel(quality.Report)
