# Grasshopper definition 27-cropped-solid-boundary.gh (Grasshopper 1.0.8)
# plug-ins: Hawa

# ---- group: 01 / INPUTS
colors = HawaColorMap(Palette="blue-green", Minimum=0, Maximum=1.2, Units="m/s")  # -> Map, Colors, Labels
# Hawa guide / purpose: HAWA / 27
# Closed solid crossing a domain boundary
# 
# A closed box extends beyond X-. Geometry classifies the full body inside the computation window. Boundary Set applies velocity to remaining fluid face nodes and preserves solid occupancy. Run and inspect the wireframe, geometry and field.
box = Box({Plane=PlaneXY(0, 0, 0), X=Domain(0, 2), Y=Domain(0, 1), Z=Domain(0, 0.8)})

# ---- group: 02 / DOMAIN / PHYSICS
# Hawa guide / operation: START / PAUSE / RESET
# Read left to right. Inputs and controls are at the left; results are at the right.
# 
# Save a copy before editing. Wait for preparation. Enable Run only when ready. Solve: Run false pauses; Reset clears state. Evaluate/Search/Record: disabling cancels.
# 
# For recordings, set a new absolute directory before starting.
domain = HawaDomain(Box=box, CellSize=0.1, LengthUnits="meters")  # -> Domain, Bounds, Grid
legend = HawaLegend(Map=colors.Map, Plane=PlaneXY(2.2, 0, 0), Height=0.7)  # -> Legend, Labels, Locations
mesh = Mesh(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)

# ---- group: 03 / GEOMETRY
# Hawa guide / limits: CHECK THE RESULT
# Stationary voxel body, uniform lattice. Solid reconstruction donors and curved-wall/NEE overlapping nodes reject before solving. This demonstrates cropped occupancy; it does not qualify arbitrary building cuts or narrow gaps.
# 
# Use the case report and component messages. Compare physical time and fixed colour ranges.
# 
# Examples and MCP instructions: README.md and ../../docs/agents/rhino-mcp.md
physics = HawaPhysics(Speed=1, Viscosity=0.1, Density=1.225, Collision="smagorinsky-v1", LatticeMach=0.03)
geometry = HawaGeometry(Domain=domain.Domain, Obstacles=mesh, CurvedWalls=False)  # -> Geometry, SolidCells
bounds = HawaDomainPreview(Domain=domain.Domain)  # -> Edges, FaceCenters, Labels

# ---- group: 04 / BUILD CASE
hawa_boundary_patch = HawaBoundaryPatch(Face="x-", Condition="velocity", Velocity=Vector(1, 0, 0), Pressure=0, Profile="uniform", ProfileAxis=1)
case = HawaCase(Domain=domain.Domain, Geometry=geometry.Geometry, Physics=physics)
hawa_boundary_patch_2 = HawaBoundaryPatch(Face="x+", Condition="open", Velocity=Vector(0, 0, 0), Pressure=0, Profile="uniform", ProfileAxis=1)
hawa_boundary_patch_3 = HawaBoundaryPatch(Face="y-", Condition="periodic", Velocity=Vector(0, 0, 0), Pressure=0, Profile="uniform", ProfileAxis=1)
hawa_boundary_patch_4 = HawaBoundaryPatch(Face="y+", Condition="periodic", Velocity=Vector(0, 0, 0), Pressure=0, Profile="uniform", ProfileAxis=1)
hawa_boundary_patch_5 = HawaBoundaryPatch(Face="z-", Condition="periodic", Velocity=Vector(0, 0, 0), Pressure=0, Profile="uniform", ProfileAxis=1)
hawa_boundary_patch_6 = HawaBoundaryPatch(Face="z+", Condition="periodic", Velocity=Vector(0, 0, 0), Pressure=0, Profile="uniform", ProfileAxis=1)

# ---- group: 05 / RESULTS / CONTROLS
boundary_set = HawaBoundarySet(
    Case=case,
    Patches=[hawa_boundary_patch, hawa_boundary_patch_2, hawa_boundary_patch_3, hawa_boundary_patch_4, hawa_boundary_patch_5, hawa_boundary_patch_6],
    InitialVelocity=Vector(0, 0, 0))  # -> Case, Plan
run = BooleanToggle(False)
reset = BooleanToggle(False)

# ---- group: 06 / RUN / CONTROL
solve = HawaSolve(Case=boundary_set.Case, Device="mps", TargetSteps=400, Run=run, Reset=reset)  # -> Solution, State, Steps, Monitor

# ---- group: 07 / CAPTURE / PLAYBACK
frame = HawaFieldSnapshot(Solution=solve.Solution, Mean=False)  # -> Frame, Time
quality = HawaResultQuality(Solution=solve.Solution)  # -> Quality, TransferEligible, Report

# ---- group: 08 / RESULTS / CONTROLS
plane = HawaPlaneField(
    Frame=frame.Frame,
    Rectangle={Plane=PlaneXY(0, 0, 0.4), Size=Domain2(u=0..2, v=0..1)},
    Resolution=30,
    Field="speed",
    Colors=colors.Map)  # -> Mesh, Contours, Values
panel = Panel(quality.Report)
