# Grasshopper definition 29-neutral-roughness-sensitivity.gh (Grasshopper 1.0.8)
# plug-ins: Hawa

# ---- group: 01 / INPUTS
colors = HawaColorMap(Palette="blue-green", Minimum=0, Maximum=7, Units="m/s")  # -> Map, Colors, Labels
# Hawa guide / purpose: HAWA / 29
# Experimental roughness sensitivity
# 
# Air viscosity is 1.5e-5 m2/s; reference wind is 5 m/s at 6 m. Change the z0 [m] slider (initial .1 m). X/Y are periodic; ground and lid lie half a cell outside the Z lattice planes. Wait for preparation, then enable Run. Compare equal physical time and wall traction.
box = Box({Plane=PlaneXY(0, 0, 0), X=Domain(0, 15), Y=Domain(0, 15), Z=Domain(0.5, 15.5)})

# ---- group: 02 / DOMAIN / PHYSICS
# Hawa guide / operation: START / PAUSE / RESET
# Read left to right. Inputs and controls are at the left; results are at the right.
# 
# Save a copy before editing. Wait for preparation. Enable Run only when ready. Solve: Run false pauses; Reset clears state. Evaluate/Search/Record: disabling cancels.
# 
# For recordings, set a new absolute directory before starting.
domain = HawaDomain(Box=box, CellSize=1, LengthUnits="meters")  # -> Domain, Bounds, Grid
physics = HawaPhysics(Speed=5, Viscosity=1.5e-05, Density=1.225, Collision="regularized", LatticeMach=0.05)
legend = HawaLegend(Map=colors.Map, Plane=PlaneXZ(17, 7.5, 0.5), Height=5)  # -> Legend, Labels, Locations

# ---- group: 03 / BUILD CASE
case = HawaCase(Domain=domain.Domain, Physics=physics)
bounds = HawaDomainPreview(Domain=domain.Domain)  # -> Edges, FaceCenters, Labels
z0_m = Slider(0.1, range=0.001..0.2)

# ---- group: 04 / RESULTS / CONTROLS
# Hawa guide / limits: CHECK THE RESULT
# Unvalidated research model; transfer disabled. Startup log-profile drift is documented in the earlier review. A longer, filtered-wall case passes bounded stationarity checks; see docs/neutral-coupling-review.md. This short example is not developed atmospheric turbulence. No buildings, thermal stability, waves or currents.
# 
# Use the case report and component messages. Compare physical time and fixed colour ranges.
# 
# Examples and MCP instructions: README.md and ../../docs/agents/rhino-mcp.md
neutral_lab = HawaNeutralPrecursor(
    Case=case,
    ReferenceHeight=6,
    RoughnessLength=z0_m,
    SmagorinskyConstant=0.17,
    PerturbationFraction=0.02,
    Experimental=True,
    WallSampleIndex=0,
    WallFilterTime=0)  # -> Case, Report
run = BooleanToggle(False)
reset = BooleanToggle(False)

# ---- group: 05 / RUN / CONTROL
solve = HawaSolve(Case=neutral_lab.Case, Device="mps", TargetSteps=400, Run=run, Reset=reset)  # -> Solution, State, Steps, Monitor

# ---- group: 06 / CAPTURE / PLAYBACK
frame = HawaFieldSnapshot(Solution=solve.Solution, Mean=False)  # -> Frame, Time
quality = HawaResultQuality(Solution=solve.Solution)  # -> Quality, TransferEligible, Report

# ---- group: 07 / RESULTS / CONTROLS
quality_report = Panel(quality.Report)
plane = HawaPlaneField(
    Frame=frame.Frame,
    Rectangle={Plane=PlaneXZ(0, 7.5, 0.5), Size=Domain2(u=0..15, v=0..15)},
    Resolution=30,
    Field="speed",
    Colors=colors.Map)  # -> Mesh, Contours, Values
