# Grasshopper definition 30-neutral-cropped-buildings.gh (Grasshopper 1.0.8)
# plug-ins: Hawa

# ---- group: 01 / INPUTS
# Hawa guide / purpose: HAWA / 30
# Neutral rough ground and cropped buildings
# 
# The left closed building extends through X-. Geometry classifies its full body and one-cell halo. Six patches feed Neutral Flow: neutral-profile X- inlet, X+ open, periodic Y, rough Z- ground and open Z+ top. Change the boxes, roughness, sampling plane or filter time. Run 1000 steps on MPS; Run false pauses.
sample_centre_domain_m = Box({Plane=PlaneXY(0, 0, 0), X=Domain(0, 31), Y=Domain(0, 17), Z=Domain(0.5, 15.5)})
colors = HawaColorMap(Palette="blue-green", Minimum=0, Maximum=8, Units="m/s")  # -> Map, Colors, Labels

# ---- group: 02 / DOMAIN / PHYSICS
closed_buildings_edit_boxes = Box([{Plane=PlaneXY(0, 0, 0), X=Domain(-3, 4.4), Y=Domain(4.6, 8.4), Z=Domain(-1, 5.2)}, {Plane=PlaneXY(0, 0, 0), X=Domain(11.6, 16.4), Y=Domain(9.6, 12.4), Z=Domain(-1, 7.2)}])
# Hawa guide / operation: START / PAUSE / RESET
# Read left to right. Inputs and controls are at the left; results are at the right.
# 
# Save a copy before editing. Wait for preparation. Enable Run only when ready. Solve: Run false pauses; Reset clears state. Evaluate/Search/Record: disabling cancels.
# 
# For recordings, set a new absolute directory before starting.
domain = HawaDomain(Box=sample_centre_domain_m, CellSize=1, LengthUnits="meters")  # -> Domain, Bounds, Grid
legend = HawaLegend(Map=colors.Map, Plane=PlaneXY(34, 0, 2.5), Height=5)  # -> Legend, Labels, Locations

# ---- group: 03 / GEOMETRY
physics = HawaPhysics(Speed=5, Viscosity=1.5e-05, Density=1.225, Collision="regularized", LatticeMach=0.05)
# Hawa guide / limits: CHECK THE RESULT
# Experimental external flow at molecular air viscosity. One writer owns each incoming link. Stationary voxel buildings; rough floor only. Open faces can reflect disturbances. Uniform or neutral profiles; imported time series and curved links are unsupported. Finite low-Mach fields do not establish city-wind accuracy; transfer is disabled. Ground is z=0, half a cell below the first sample. Read docs/neutral-coupling-review.md.
# 
# Use the case report and component messages. Compare physical time and fixed colour ranges.
# 
# Examples and MCP instructions: README.md and ../../docs/agents/rhino-mcp.md
geometry = HawaGeometry(Domain=domain.Domain, CurvedWalls=False, SolidBreps=closed_buildings_edit_boxes)  # -> Geometry, SolidCells
bounds = HawaDomainPreview(Domain=domain.Domain)  # -> Edges, FaceCenters, Labels

# ---- group: 04 / BUILD CASE
case = HawaCase(Domain=domain.Domain, Geometry=geometry.Geometry, Physics=physics)
x_velocity = HawaBoundaryPatch(Face="x-", Condition="velocity", Velocity=Vector(5, 0, 0), Pressure=0, Profile="neutral", ProfileAxis=1)
x_open = HawaBoundaryPatch(Face="x+", Condition="open", Velocity=Vector(-5, 0, 0), Pressure=0, Profile="neutral", ProfileAxis=1)
y_periodic = HawaBoundaryPatch(Face="y-", Condition="periodic", Velocity=Vector(0, 0, 0), Pressure=0, Profile="uniform", ProfileAxis=1)
y_periodic_2 = HawaBoundaryPatch(Face="y+", Condition="periodic", Velocity=Vector(0, 0, 0), Pressure=0, Profile="uniform", ProfileAxis=1)
z_wall = HawaBoundaryPatch(Face="z-", Condition="wall", Velocity=Vector(0, 0, 0), Pressure=0, Profile="uniform", ProfileAxis=1)
z_open = HawaBoundaryPatch(Face="z+", Condition="open", Velocity=Vector(0, 0, 0), Pressure=0, Profile="uniform", ProfileAxis=1)
z0_m = Slider(0.01, range=0.001..0.2)

# ---- group: 05 / RESULTS / CONTROLS
neutral_lab = HawaNeutralFlow(
    Case=case,
    ReferenceHeight=6,
    RoughnessLength=z0_m,
    SmagorinskyConstant=0.17,
    PerturbationFraction=0.02,
    Experimental=True,
    WallSampleIndex=1,
    WallFilterTime=3,
    ExternalPatches=[x_velocity, x_open, y_periodic, y_periodic_2, z_wall, z_open])  # -> Case, Report
run = BooleanToggle(False)
reset = BooleanToggle(False)

# ---- group: 06 / RUN / CONTROL
solve = HawaSolve(Case=neutral_lab.Case, Device="mps", TargetSteps=1000, Run=run, Reset=reset)  # -> Solution, State, Steps, Monitor

# ---- group: 07 / CAPTURE / PLAYBACK
frame = HawaFieldSnapshot(Solution=solve.Solution, Mean=False)  # -> Frame, Time
quality = HawaResultQuality(Solution=solve.Solution)  # -> Quality, TransferEligible, Report

# ---- group: 08 / RESULTS / CONTROLS
quality_boundary_budget = Panel(quality.Report)
plane = HawaPlaneField(
    Frame=frame.Frame,
    Rectangle={Plane=PlaneXY(0, 0, 2.5), Size=Domain2(u=0..31, v=0..17)},
    Resolution=30,
    Field="speed",
    Colors=colors.Map)  # -> Mesh, Contours, Values
