# Grasshopper definition 31-tunnel-probes-checkpoint.gh (Grasshopper 1.0.8)
# plug-ins: Hawa

# ---- group: 01 / INPUTS
# Hawa guide / purpose: HAWA / 31
# Wind tunnel, probes and checkpoints
# 
# Use metres in Rhino. Replace the closed mesh; Wind Tunnel sizes and orients its domain. Set Initialize runtime if needed, then Run. Probes sample pressure and velocity; Vectors draws the measured velocity. Pause before a file action. Set an absolute .npz path, choose save, load or export on Checkpoint, then toggle Execute off and on.
closed_body_mesh_replace = Mesh(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)
initialize_runtime = BooleanToggle(False)

# ---- group: 02 / RESULTS / CONTROLS
# Hawa guide / operation: START / PAUSE / RESET
# Read left to right. Inputs and controls are at the left; results are at the right.
# 
# Save a copy before editing. Wait for preparation. Enable Run only when ready. Solve: Run false pauses; Reset clears state. Evaluate/Search/Record: disabling cancels.
# 
# For recordings, set a new absolute directory before starting.
tunnel = HawaWindTunnel(Geometry=closed_body_mesh_replace, Wind=Vector(1, 0, 0), CellSize=1, Clearance=2, GroundMounted=False)  # -> Domain, Bounds, Speed
runtime = HawaRuntime(Initialize=initialize_runtime)  # -> Runtime, Credits

# ---- group: 03 / GEOMETRY
panel = Panel(runtime.Runtime)
physics = HawaPhysics(Speed=tunnel.Speed, Viscosity=0.1, Density=1.225, Collision="regularized", LatticeMach=0.05)
# Hawa guide / limits: CHECK THE RESULT
# A short CPU demonstration at viscous conditions, not an aerodynamic accuracy result. Checkpoint load requires the same case. Saving checkpoints pauses the solver. Execute is a rising-edge action and opens idle. Probe points must remain in fluid. Wind Tunnel uses Rhino document units; physical wind speed is m/s.
# 
# Use the case report and component messages. Compare physical time and fixed colour ranges.
# 
# Examples and MCP instructions: README.md and ../../docs/agents/rhino-mcp.md
geometry = HawaGeometry(Domain=tunnel.Domain, Obstacles=closed_body_mesh_replace, CurvedWalls=False)  # -> Geometry, SolidCells
bounds = HawaDomainPreview(Domain=tunnel.Domain)  # -> Edges, FaceCenters, Labels

# ---- group: 04 / BUILD CASE
case = HawaCase(Domain=tunnel.Domain, Geometry=geometry.Geometry, Physics=physics)
run = BooleanToggle(False)

# ---- group: 05 / RUN / CONTROL
fluid_probes_seeds = Point([Point(2, 3, 5), Point(2, 8, 5), Point(3, 7, 7)])
checkpoint_path = Panel("Choose an absolute path ending in .npz")
solve = HawaSolve(Case=case, Device="cpu", TargetSteps=60, Run=run, Reset=False)  # -> Solution, State, Steps, Monitor
execute_file_action = BooleanToggle(False)

# ---- group: 06 / RESULTS / CONTROLS
sample = HawaSample(Solution=solve.Solution, Points=fluid_probes_seeds, Mean=False)  # -> Velocity, Pressure, Valid
checkpoint = HawaCheckpoint(Solution=solve.Solution, Path=checkpoint_path, Operation="save", Execute=execute_file_action)
quality = HawaResultQuality(Solution=solve.Solution)  # -> Quality, TransferEligible, Report

# ---- group: 07 / RESULTS / CONTROLS
panel_2 = Panel(quality.Report)
pressure_pa = Panel(sample.Pressure)
panel_3 = Panel(checkpoint)
vectors = HawaVectors(Points=fluid_probes_seeds, Velocity=sample.Velocity, Scale=2)
