# Grasshopper definition 32-translation-particle-recording.gh (Grasshopper 1.0.8)
# plug-ins: Hawa

# ---- group: 01 / INPUTS
# Hawa guide / purpose: HAWA / 32
# Translation, recording and particle paths
# 
# A closed mesh translates along Y at 0.05 m/s. Set a new absolute directory, then Record. After 40 steps, use the Frame index slider to view body pose. Particles integrates through frames 0 to 4 and draws three fluid paths. Edit Translation to set direction, speed and startup ramp; choose a new directory for another recording.
box = Box({Plane=PlaneXY(0, 0, 0), X=Domain(0, 11), Y=Domain(0, 11), Z=Domain(0, 11)})

# ---- group: 02 / DOMAIN / PHYSICS
# Hawa guide / operation: START / PAUSE / RESET
# Read left to right. Inputs and controls are at the left; results are at the right.
# 
# Save a copy before editing. Wait for preparation. Enable Run only when ready. Solve: Run false pauses; Reset clears state. Evaluate/Search/Record: disabling cancels.
# 
# For recordings, set a new absolute directory before starting.
domain = HawaDomain(Box=box, CellSize=1, LengthUnits="meters")  # -> Domain, Bounds, Grid
physics = HawaPhysics(Speed=1, Viscosity=0.1, Density=1.225, Collision="bgk", LatticeMach=0.05)

# ---- group: 03 / BUILD CASE
closed_body_mesh_replace = Mesh(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)
case = HawaCase(Domain=domain.Domain, Physics=physics)
bounds = HawaDomainPreview(Domain=domain.Domain)  # -> Edges, FaceCenters, Labels
translate = HawaTranslation(Axis=Vector(0, 1, 0), Speed=0.05, Ramp=0.1)

# ---- group: 04 / PREPARE BODY
# Hawa guide / limits: CHECK THE RESULT
# Prescribed motion, uniform BGK and a single fluid. The body must stay clear of the domain boundary. Coarse short demonstration, not a force validation. Particle trails use changing recorded fields; they differ from steady flowlines. Record false cancels; Pause holds the job. A saved true switch opens idle.
# 
# Use the case report and component messages. Compare physical time and fixed colour ranges.
# 
# Examples and MCP instructions: README.md and ../../docs/agents/rhino-mcp.md
body = HawaMovingBody(Case=case, Mesh=closed_body_mesh_replace, Motion=translate, Pivot=Point(5.5, 5.5, 5.5), BodyID="body")  # -> Body, Report

# ---- group: 05 / BUILD CASE
recording_directory = Panel("Choose a new absolute recording directory")
motioncase = HawaMotionCase(Case=case, Bodies=body.Body)
record = BooleanToggle(False)
pause_recording = BooleanToggle(False)

# ---- group: 06 / RUN / CONTROL
record_2 = HawaRecord(Case=motioncase, Directory=recording_directory, Steps=40, Interval=10, Device="cpu", Run=record, Pause=pause_recording)  # -> Manifest, State, Solution
frame_index = Slider(4, range=0..4)

# ---- group: 07 / CAPTURE / PLAYBACK
fluid_probes_seeds = Point([Point(2, 3, 5), Point(2, 8, 5), Point(3, 7, 7)])
panel = Panel(record_2.State)
playback = HawaPlayback(Manifest=record_2.Manifest, Index=frame_index)  # -> Frame, Time

# ---- group: 08 / FIELDS / LOADS
particles = HawaParticles(Manifest=record_2.Manifest, Frame=playback.Frame, Seeds=fluid_probes_seeds, LastFrame=4)  # -> Trails, Particles
loads = HawaBodyLoads(SolutionOrFrame=playback.Frame)  # -> Force, Torque, Power, BodyIDs, MotionState

# ---- group: 09 / BODY / OUTPUT
bodyview = HawaBodyPreview(ReferenceMesh=closed_body_mesh_replace, MotionState=loads.MotionState, BodyID="body")
