# Grasshopper definition 33-neutral-city-to-pond.gh (Grasshopper 1.0.8)
# plug-ins: Hawa

closed_buildings_shared_full_geometry = Box([{Plane=PlaneXY(0, 0, 0), X=Domain(3, 6), Y=Domain(7, 10), Z=Domain(-1, 4)}, {Plane=PlaneXY(0, 0, 0), X=Domain(10, 12), Y=Domain(6, 9), Z=Domain(-1, 5)}])
# Hawa guide / purpose: HAWA / 33
# City → neighbourhood → pond
# 
# Three uniform air grids at 1 m, 0.5 m and 0.25 m. Timed velocity and pressure pass between cases on every open face. Each child starts from the parent field.
# 
# The boxes are ordinary GH geometry. They cross the child boundaries. The pond is a low-roughness ground region; there is no water/free-surface solver.
# Hawa guide / operation: RUN / AUTOMATIC DEPENDENCIES
# Save a copy and choose five new absolute paths. Open with all Record and Capture controls off.
# Enable the five stage controls. Each waits for its upstream result; no UI waiting loop is used. Pause acts on the running Record. Disable to cancel.
# The pond capture starts at neighbourhood t=0.369504 s to exclude its startup pressure transient. Its 1792 steps end at the same absolute time as the other cases. If physics or capture time changes, match the child duration and playback frame.
physics = HawaPhysics(Speed=5, Viscosity=1.5e-05, Density=1.225, Collision="regularized", LatticeMach=0.05)
city_1_m_cells = TextTag3D(Location=PlaneXY(0.5, 23.5, 15.5), Text="CITY / 1 m cells", Size=0.35, Colour=RGB(60, 97, 97), Justification=7)
neighbourhood_0_5_m_cells = TextTag3D(
    Location=PlaneXY(4.25, 15.75, 7.75),
    Text="NEIGHBOURHOOD / 0.5 m cells",
    Size=0.35,
    Colour=RGB(60, 97, 97),
    Justification=7)
pond_0_25_m_cells = TextTag3D(Location=PlaneXY(8.125, 12.875, 3.875), Text="POND / 0.25 m cells", Size=0.35, Colour=RGB(60, 97, 97), Justification=7)
label_city_1_m_cells = TextTag(Location=Point(0.5, 23.5, 16.5), Text="CITY / 1 m cells", Colour=RGB(20, 35, 40))
label_neighbourhood_0_5_m_cells = TextTag(Location=Point(4.25, 15.75, 8.75), Text="NEIGHBOURHOOD / 0.5 m cells", Colour=RGB(20, 35, 40))
label_pond_0_25_m_cells = TextTag(Location=Point(20, -5, 0), Text="POND / 0.25 m cells", Colour=RGB(20, 35, 40))
pond_label_leader = Line(Line((13.875, 7.125, 3.875), (20, -5, 0)))
shared_slice_height_m = Slider(1.5, range=0.5..15.5)
slice_origin = ConstructPoint(XCoordinate=0.5, YCoordinate=0.5, ZCoordinate=shared_slice_height_m)
slice_plane = XYPlane(Origin=slice_origin)
slice_extent = Rectangle(Plane=slice_plane, XSize=Domain(0, 31), YSize=Domain(0, 23), Radius=0)  # -> Rectangle, Length

# ---- group: B / neighbourhood
# Hawa guide / stage 1: B / neighbourhood
# Cell width = 0.5 m
# Air: Uref = 5 m/s, ν = 1.5e-5 m²/s
# Closed buildings are reclassified on this grid. The floor is half a cell below its first sample centre.
# 
# Start Capture and Record only after their input data is ready.
b_neighbourhood_domain_centres = Box({Plane=PlaneXY(0, 0, 0), X=Domain(4.25, 15.75), Y=Domain(4.25, 15.75), Z=Domain(0.25, 7.75)})
domain = HawaDomain(Box=b_neighbourhood_domain_centres, CellSize=0.5, LengthUnits="meters")  # -> Domain, Bounds, Grid
geometry = HawaGeometry(Domain=domain.Domain, CurvedWalls=False, SolidBreps=closed_buildings_shared_full_geometry)  # -> Geometry, SolidCells
bounds = HawaDomainPreview(Domain=domain.Domain)  # -> Edges, FaceCenters, Labels
case = HawaCase(Domain=domain.Domain, Geometry=geometry.Geometry, Physics=physics)
x_open = HawaBoundaryPatch(
    Face="x-",
    Condition="open",
    Velocity=Vector(0, 0, 0),
    Pressure=0,
    Profile="uniform",
    ProfileAxis=1,
    BackflowMode="pressure")
x_open_2 = HawaBoundaryPatch(
    Face="x+",
    Condition="open",
    Velocity=Vector(0, 0, 0),
    Pressure=0,
    Profile="uniform",
    ProfileAxis=1,
    BackflowMode="pressure")
y_open = HawaBoundaryPatch(
    Face="y-",
    Condition="open",
    Velocity=Vector(0, 0, 0),
    Pressure=0,
    Profile="uniform",
    ProfileAxis=1,
    BackflowMode="pressure")
y_open_2 = HawaBoundaryPatch(
    Face="y+",
    Condition="open",
    Velocity=Vector(0, 0, 0),
    Pressure=0,
    Profile="uniform",
    ProfileAxis=1,
    BackflowMode="pressure")
z_wall = HawaBoundaryPatch(
    Face="z-",
    Condition="wall",
    Velocity=Vector(0, 0, 0),
    Pressure=0,
    Profile="uniform",
    ProfileAxis=1,
    BackflowMode="velocity")
z_open = HawaBoundaryPatch(
    Face="z+",
    Condition="open",
    Velocity=Vector(0, 0, 0),
    Pressure=0,
    Profile="uniform",
    ProfileAxis=1,
    BackflowMode="pressure")
neutral_lab = HawaNeutralFlow(
    Case=case,
    ReferenceHeight=4,
    RoughnessLength=0.01,
    SmagorinskyConstant=0.17,
    PerturbationFraction=0.02,
    Experimental=True,
    WallSampleIndex=0,
    WallFilterTime=0.1,
    ExternalPatches=[x_open, x_open_2, y_open, y_open_2, z_wall, z_open])  # -> Case, Report
b_neighbourhood_new_boundary_file = Panel("/choose/a/new/neighbourhood-boundary.npz")
b_neighbourhood_capture = BooleanToggle(False)
b_neighbourhood_new_directory = Panel("/choose/a/new/neighbourhood-recording")
b_neighbourhood_record = BooleanToggle(False)
b_neighbourhood_pause = BooleanToggle(False)
colors = HawaColorMap(Palette="blue-green", Minimum=0, Maximum=8, Units="m/s")  # -> Map, Colors, Labels

# ---- group: C / pond
# Hawa guide / stage 2: C / pond
# Cell width = 0.25 m
# Air: Uref = 5 m/s, ν = 1.5e-5 m²/s
# Closed buildings are reclassified on this grid. The floor is half a cell below its first sample centre.
# 
# Start Capture and Record only after their input data is ready.
c_pond_domain_centres = Box({Plane=PlaneXY(0, 0, 0), X=Domain(8.125, 13.875), Y=Domain(7.125, 12.875), Z=Domain(0.125, 3.875)})
domain_2 = HawaDomain(Box=c_pond_domain_centres, CellSize=0.25, LengthUnits="meters")  # -> Domain, Bounds, Grid
geometry_2 = HawaGeometry(Domain=domain_2.Domain, CurvedWalls=False, SolidBreps=closed_buildings_shared_full_geometry)  # -> Geometry, SolidCells
bounds_2 = HawaDomainPreview(Domain=domain_2.Domain)  # -> Edges, FaceCenters, Labels
case_2 = HawaCase(Domain=domain_2.Domain, Geometry=geometry_2.Geometry, Physics=physics)
x_open_3 = HawaBoundaryPatch(
    Face="x-",
    Condition="open",
    Velocity=Vector(0, 0, 0),
    Pressure=0,
    Profile="uniform",
    ProfileAxis=1,
    BackflowMode="pressure")
x_open_4 = HawaBoundaryPatch(
    Face="x+",
    Condition="open",
    Velocity=Vector(0, 0, 0),
    Pressure=0,
    Profile="uniform",
    ProfileAxis=1,
    BackflowMode="pressure")
y_open_3 = HawaBoundaryPatch(
    Face="y-",
    Condition="open",
    Velocity=Vector(0, 0, 0),
    Pressure=0,
    Profile="uniform",
    ProfileAxis=1,
    BackflowMode="pressure")
y_open_4 = HawaBoundaryPatch(
    Face="y+",
    Condition="open",
    Velocity=Vector(0, 0, 0),
    Pressure=0,
    Profile="uniform",
    ProfileAxis=1,
    BackflowMode="pressure")
z_wall_2 = HawaBoundaryPatch(
    Face="z-",
    Condition="wall",
    Velocity=Vector(0, 0, 0),
    Pressure=0,
    Profile="uniform",
    ProfileAxis=1,
    BackflowMode="velocity")
z_open_2 = HawaBoundaryPatch(
    Face="z+",
    Condition="open",
    Velocity=Vector(0, 0, 0),
    Pressure=0,
    Profile="uniform",
    ProfileAxis=1,
    BackflowMode="pressure")
neutral_lab_2 = HawaNeutralFlow(
    Case=case_2,
    ReferenceHeight=2,
    RoughnessLength=0.01,
    SmagorinskyConstant=0.17,
    PerturbationFraction=0.02,
    Experimental=True,
    WallSampleIndex=0,
    WallFilterTime=0.1,
    ExternalPatches=[x_open_3, x_open_4, y_open_3, y_open_4, z_wall_2, z_open_2])  # -> Case, Report
c_pond_new_boundary_file = Panel("/choose/a/new/pond-boundary.npz")
roughness = HawaWallRoughness(Case=neutral_lab_2.Case, Regions={Plane=PlaneXY(0, 0, 0), Size=Domain2(u=10..14, v=9..13)}, RoughnessLengths=0.0002)  # -> Case, Report
c_pond_capture = BooleanToggle(False)
c_pond_new_directory = Panel("/choose/a/new/pond-recording")
c_pond_record = BooleanToggle(False)
c_pond_pause = BooleanToggle(False)
colors_2 = HawaColorMap(Palette="blue-green", Minimum=0, Maximum=8, Units="m/s")  # -> Map, Colors, Labels

# ---- group: A / city
# Hawa guide / stage 0: A / city
# Cell width = 1 m
# Air: Uref = 5 m/s, ν = 1.5e-5 m²/s
# Closed buildings are reclassified on this grid. The floor is half a cell below its first sample centre.
# 
# Start Capture and Record only after their input data is ready.
a_city_domain_centres = Box({Plane=PlaneXY(0, 0, 0), X=Domain(0.5, 31.5), Y=Domain(0.5, 23.5), Z=Domain(0.5, 15.5)})
domain_3 = HawaDomain(Box=a_city_domain_centres, CellSize=1, LengthUnits="meters")  # -> Domain, Bounds, Grid
geometry_3 = HawaGeometry(Domain=domain_3.Domain, CurvedWalls=False, SolidBreps=closed_buildings_shared_full_geometry)  # -> Geometry, SolidCells
bounds_3 = HawaDomainPreview(Domain=domain_3.Domain)  # -> Edges, FaceCenters, Labels
case_3 = HawaCase(Domain=domain_3.Domain, Geometry=geometry_3.Geometry, Physics=physics)
x_velocity = HawaBoundaryPatch(
    Face="x-",
    Condition="velocity",
    Velocity=Vector(5, 0, 0),
    Pressure=0,
    Profile="neutral",
    ProfileAxis=1,
    BackflowMode="velocity")
x_open_5 = HawaBoundaryPatch(
    Face="x+",
    Condition="open",
    Velocity=Vector(0, 0, 0),
    Pressure=0,
    Profile="neutral",
    ProfileAxis=1,
    BackflowMode="pressure")
y_periodic = HawaBoundaryPatch(
    Face="y-",
    Condition="periodic",
    Velocity=Vector(0, 0, 0),
    Pressure=0,
    Profile="uniform",
    ProfileAxis=1,
    BackflowMode="velocity")
y_periodic_2 = HawaBoundaryPatch(
    Face="y+",
    Condition="periodic",
    Velocity=Vector(0, 0, 0),
    Pressure=0,
    Profile="uniform",
    ProfileAxis=1,
    BackflowMode="velocity")
z_wall_3 = HawaBoundaryPatch(
    Face="z-",
    Condition="wall",
    Velocity=Vector(0, 0, 0),
    Pressure=0,
    Profile="uniform",
    ProfileAxis=1,
    BackflowMode="velocity")
z_slip = HawaBoundaryPatch(
    Face="z+",
    Condition="slip",
    Velocity=Vector(0, 0, 0),
    Pressure=0,
    Profile="uniform",
    ProfileAxis=1,
    BackflowMode="velocity")
# Hawa guide / limits: CHECK BEFORE INTERPRETING
# The defaults are a short transfer demonstration. They do not establish settled wind or turbulent statistics. Read Result Quality and Flow Statistics separately.
# 
# For a study: record a longer parent, discard startup with Capture Start/End, match child duration to that window, increase averaging and compare grid/domain/time sensitivity. Buildings need closed full geometry. Parent fluid must cover every child fluid sample.
# Hawa guide / mapping: ONE VIEW / THREE DOMAINS
# All three Playback frames feed Shared slice. The finest containing domain supplies each sample. Move the slice-height slider; above a child, the parent remains visible. Domain tags identify each grid.
# The renderer trims faces at halfway building walls and reconstructs boundary colours. Raw sample validity stays unchanged. Curved-link fields keep conservative masking.
# Times must agree. Hide an unrelated native case with its Domain, Body and Field checkboxes. Field 0 is not this recording.
# Transfer includes velocity, pressure, strain, initial fields, absolute time and source hashes. Matching wall-filter history is retained.
neutral_lab_3 = HawaNeutralFlow(
    Case=case_3,
    ReferenceHeight=6,
    RoughnessLength=0.01,
    SmagorinskyConstant=0.17,
    PerturbationFraction=0.02,
    Experimental=True,
    WallSampleIndex=0,
    WallFilterTime=0.1,
    ExternalPatches=[x_velocity, x_open_5, y_periodic, y_periodic_2, z_wall_3, z_slip])  # -> Case, Report
a_city_new_directory = Panel("/choose/a/new/city-recording")
a_city_record = BooleanToggle(False)
a_city_pause = BooleanToggle(False)
a_city_record_2 = HawaRecord(
    Case=neutral_lab_3.Case,
    Directory=a_city_new_directory,
    Steps=512,
    Interval=8,
    Device="cpu",
    Run=a_city_record,
    Pause=a_city_pause)  # -> Manifest, State, Solution
colors_3 = HawaColorMap(Palette="blue-green", Minimum=0, Maximum=8, Units="m/s")  # -> Map, Colors, Labels
playback = HawaPlayback(Manifest=a_city_record_2.Manifest, Index=64)  # -> Frame, Time
quality = HawaResultQuality(Solution=a_city_record_2.Solution)  # -> Quality, TransferEligible, Report
a_city_numerical_quality = Panel(quality.Report)
statistics = HawaFlowStatistics(Manifest=a_city_record_2.Manifest, Frame=playback.Frame, Probes=Point(20, 14, 2.5), StartTime=0, EndTime=-1)  # -> MeanVelocity, MeanPressure, ResolvedTKE, Report, Statistics
a_city_sampling_quality = Panel(statistics.Report)

# ---- group: B / neighbourhood (continued)
capture_bc = HawaBoundaryCapture(
    ParentRecording=a_city_record_2.Manifest,
    ChildCase=neutral_lab.Case,
    NewBoundaryFile=b_neighbourhood_new_boundary_file,
    Capture=b_neighbourhood_capture,
    StartTime=0,
    EndTime=-1)  # -> MappedCase, BoundaryFile, Report
read_bc = HawaBoundaryData(BoundaryFile=capture_bc.BoundaryFile, ChildCase=neutral_lab.Case, Reload=0)  # -> MappedCase, Report
b_neighbourhood_record_2 = HawaRecord(
    Case=read_bc.MappedCase,
    Directory=b_neighbourhood_new_directory,
    Steps=1024,
    Interval=16,
    Device="cpu",
    Run=b_neighbourhood_record,
    Pause=b_neighbourhood_pause)  # -> Manifest, State, Solution
playback_2 = HawaPlayback(Manifest=b_neighbourhood_record_2.Manifest, Index=64)  # -> Frame, Time
quality_2 = HawaResultQuality(Solution=b_neighbourhood_record_2.Solution)  # -> Quality, TransferEligible, Report
plane = HawaPlaneField(
    Frame=playback_2.Frame,
    Rectangle={Plane=PlaneXY(4.25, 4.25, 2.5), Size=Domain2(u=0..11.5, v=0..11.5)},
    Resolution=30,
    Field="speed",
    Colors=colors.Map)  # -> Mesh, Contours, Values
b_neighbourhood_numerical_quality = Panel(quality_2.Report)
statistics_2 = HawaFlowStatistics(Manifest=b_neighbourhood_record_2.Manifest, Frame=playback_2.Frame, Probes=Point(14, 14, 2.5), StartTime=0, EndTime=-1)  # -> MeanVelocity, MeanPressure, ResolvedTKE, Report, Statistics
b_neighbourhood_sampling_quality = Panel(statistics_2.Report)

# ---- group: C / pond (continued)
capture_bc_2 = HawaBoundaryCapture(
    ParentRecording=b_neighbourhood_record_2.Manifest,
    ChildCase=roughness.Case,
    NewBoundaryFile=c_pond_new_boundary_file,
    Capture=c_pond_capture,
    StartTime=0.3695041723,
    EndTime=-1)  # -> MappedCase, BoundaryFile, Report
read_bc_2 = HawaBoundaryData(BoundaryFile=capture_bc_2.BoundaryFile, ChildCase=roughness.Case, Reload=0)  # -> MappedCase, Report
c_pond_record_2 = HawaRecord(
    Case=read_bc_2.MappedCase,
    Directory=c_pond_new_directory,
    Steps=1792,
    Interval=32,
    Device="cpu",
    Run=c_pond_record,
    Pause=c_pond_pause)  # -> Manifest, State, Solution
playback_3 = HawaPlayback(Manifest=c_pond_record_2.Manifest, Index=56)  # -> Frame, Time
quality_3 = HawaResultQuality(Solution=c_pond_record_2.Solution)  # -> Quality, TransferEligible, Report
plane_2 = HawaPlaneField(
    Frame=playback_3.Frame,
    Rectangle={Plane=PlaneXY(8.125, 7.125, 1.5), Size=Domain2(u=0..5.75, v=0..5.75)},
    Resolution=30,
    Field="speed",
    Colors=colors_2.Map)  # -> Mesh, Contours, Values
c_pond_numerical_quality = Panel(quality_3.Report)
statistics_3 = HawaFlowStatistics(Manifest=c_pond_record_2.Manifest, Frame=playback_3.Frame, Probes=Point(13, 11, 1.5), StartTime=0, EndTime=-1)  # -> MeanVelocity, MeanPressure, ResolvedTKE, Report, Statistics
c_pond_sampling_quality = Panel(statistics_3.Report)

# ----
shared_speed_legend = HawaLegend(Map=colors_3.Map, Plane=PlaneXY(34, 2, 1.5), Height=10)  # -> Legend, Labels, Locations

# ---- group: A / city (continued)
shared_slice_finest_domain = HawaPlaneField(
    Frame=[playback.Frame, playback_2.Frame, playback_3.Frame],
    Rectangle=slice_extent.Rectangle,
    Resolution=30,
    Field="speed",
    Colors=colors_3.Map)  # -> Mesh, Contours, Values
