# Grasshopper definition 21-native-live-sync.gh (Grasshopper 1.0.8)
# plug-ins: Hawa

# HAWA 0.5 / NATIVE LIVE SYNC
# 
# 1. Run Hawa in Rhino to open the dockable panel.
# 2. These three sliders and the panel edit one shared case.
# 3. Press Run in the panel. Edits mark the result outdated.
# 4. Pause, resume or cancel from the panel.
# 5. Save the Rhino file and this definition together.
# 
# The native panel owns the solver. Closing GH leaves the case running.
# This example uses a fixed block domain. Use example 22 for selected Rhino bodies and editable domains.
# The default field uses an automatic blue-green scale. Change palettes in View. Values are experimental.
inlet_speed_m_s = Slider(1, range=0.1..3)
cell_size_m = Slider(0.5, range=0.25..1)
block_width_m = Slider(1, range=0.5..2)
livecase = HawaLinkedCase(InletSpeed=inlet_speed_m_s, CellSize=cell_size_m, BlockWidth=block_width_m)  # -> Solution, FieldPreview, Status, CaseID
panel = Panel(livecase.Status)
