# Grasshopper definition 22-native-selected-geometry.gh (Grasshopper 1.0.8)
# plug-ins: Hawa

# ---- group: 01 / Physical controls · SI
# HAWA 0.5 / SELECTED RHINO GEOMETRY
# 
# Open 22-selected-canopy.3dm first, then run Hawa.
# This definition binds to that document's native case.
# Two sliders control speed and cell size. Leave block width disconnected.
# Right-click a slider to enter a precise physical value.
inlet_speed_m_s = Slider(1, range=0.001..300)
# 2 / CHECK THE RESULT
# 
# Expected: visible domain, coloured field and a capture step/time.
# The field output is withheld while outdated. Missing/deleted bodies fail explicitly.
# Coarse stationary single-fluid demonstration; viscosity 0.1 m²/s.
# No RC aerodynamic accuracy, moving body, free surface or force claim.
# Compare equal physical time and fixed colour limits.
cell_size_m = Slider(0.05, range=1e-05..100)

# ---- group: 02 / Native case and field
livecase = HawaLinkedCase(InletSpeed=inlet_speed_m_s, CellSize=cell_size_m)  # -> Solution, FieldPreview, Status, CaseID

# ---- group: 03 / State and capture provenance
# 1 / EDIT AND RUN
# 
# Setup: select closed bodies, edit domain/fluid and Apply setup.
# Solve: set backend and target; Run, Pause or Cancel.
# View: choose field, slice and palette; Apply display.
# Edit the Rhino mesh to invalidate the old run.
# Save your 3dm and bound GH definition together.
panel = Panel(livecase.Status)
